vi "MAIN.gviweb"   [LabVIEW NXG 5.1.0]
panel controls:
  "Tab": i32
panel indicators:
  "URL Image": string
  "Disk Free (GB)": string
  "Disk Free (%)": string
  "RAM Free (%)": string
  "CPU Utilization (%)": string
  "Current Position": string
  "Date & Time": string
  "Heading": string
  "Offset Distance": string
  "Uptime": string
  "Separation Distance": f64
  "System Status Array": string[]
  "SD Filter Status": bool[]
  "Latitude": f64
  "Longitude": f64
  "Height (m)": f64
  "Vel N (m/s)": f32
  "Vel E (m/s)": f32
  "Vel D (m/s)": f32
  "G force (g)": f32
  "Pitch (deg)": f32
  "Roll (deg)": f32
  "Heading (deg)": f32
  "X_2": f32
  "Body Acc Y (m/s/s)": f32
  "Body Acc Z (m/s/s)": f32
  "X": f32
  "Y": f32
  "Z": f32
  "Filter Status": u16
  "System Status": u16
  "uS": u32
  "Unix TS": u32
uses:
  NI::HTTP::GET.gvi
  WebApp::HMI_Cluster_RD.gvi
diagram:
  Concatenate Strings("http://", "192.174.56.153", ":", "8001", "/HMI/") -> w1
  Concatenate Strings(w1, "HMIDataHTTPPost")
  Concatenate Strings(w1, "HTTP_Get_Data") -> w2
  call "GET.gvi"(url=w2) -> (body=w3)
  Search Or Split String(search string/char="{", string=w3) -> (match + rest of string=w4)
  call "HMI_Cluster_RD.gvi"() -> (HMI Cluster Out=w5)
  Unflatten From Json(JSON string=w4, type and defaults=w5) -> (value=w6)
  Property Node(instance in=w6) -> ("Separation Distance"=w7, "System Status Array"=w8, "SD Filter Status"=w9, "Packet 20 Decoded Data Cluster 2"=w10)
  $"Separation Distance" <- w7
  $"System Status Array" <- w8
  $"SD Filter Status" <- w9
  Property Node(instance in=w10) -> ("Unix TS"=w11, "uS"=w12, "Latitude"=w13, "Longitude"=w14, "Height (m)"=w15, "Vel N (m/s)"=w16, "Vel E (m/s)"=w17, "Vel D (m/s)"=w18, "G force (g)"=w19, "Pitch (deg)"=w20, "Roll (deg)"=w21, "Heading (deg)"=w22, "Body Acc X (m/s/s)"=w23, "Body Acc Y (m/s/s)"=w24, "Body Acc Z (m/s/s)"=w25, "Angular Vel X (rad/s)"=w26, "Angular Vel Y (rad/s)"=w27, "Angular Vel Z (rad/s)"=w28, "Filter Status"=w29, "System Status"=w30)
  $"Unix TS" <- w11
  $uS <- w12
  $Latitude <- w13
  $Longitude <- w14
  $"Height (m)" <- w15
  $"Vel N (m/s)" <- w16
  $"Vel E (m/s)" <- w17
  $"Vel D (m/s)" <- w18
  $"G force (g)" <- w19
  $"Pitch (deg)" <- w20
  $"Roll (deg)" <- w21
  $"Heading (deg)" <- w22
  $X_2 <- w23
  Concatenate Strings(w1, "HMIStartStopPost")
  $"Body Acc Y (m/s/s)" <- w24
  $"Body Acc Z (m/s/s)" <- w25
  $X <- w26
  $Y <- w27
  $Z <- w28
  $"Filter Status" <- w29
  $"System Status" <- w30
